# Dynamo graph CAMBIAR MASIVAMENTE LOS ESTILOS DE ALINEAMIENTOS.dyn (Dynamo 4.0.2.3852)

python_script = Python()  # PythonNet3; unwired: IN[0]
# ---------- python_script.python (22 lines) ----------
import clr
clr.AddReference('AeccDbMgd')
clr.AddReference('AcDbMgd')

from Autodesk.AutoCAD.ApplicationServices import Application
from Autodesk.AutoCAD.DatabaseServices import OpenMode
from Autodesk.Civil.ApplicationServices import CivilApplication

doc = Application.DocumentManager.MdiActiveDocument
db = doc.Database
civDoc = CivilApplication.ActiveDocument

results = []

with doc.LockDocument():
    with db.TransactionManager.StartTransaction() as tr:
        for styleId in civDoc.Styles.AlignmentStyles:
            style = tr.GetObject(styleId, OpenMode.ForRead)
            results.append(style.Name)
        tr.Commit()

OUT = results
# ----------------------------------------
elige_el_estilo = IntegerSlider(0, range=0..20 step 1)
python_script_2 = Python(IN[0]=python_script, IN[1]=elige_el_estilo)  # PythonNet3
# ---------- python_script_2.python (45 lines) ----------
import clr
clr.AddReference('AeccDbMgd')
clr.AddReference('AcDbMgd')

from Autodesk.AutoCAD.ApplicationServices import Application
from Autodesk.Civil.DatabaseServices import Alignment
from Autodesk.AutoCAD.DatabaseServices import OpenMode, BlockTableRecord
from Autodesk.Civil.ApplicationServices import CivilApplication

doc = Application.DocumentManager.MdiActiveDocument
db = doc.Database
civDoc = CivilApplication.ActiveDocument

style_list = IN[0]
selected_index = IN[1]
results = []
target_style_id = None

if style_list is None or selected_index is None:
    OUT = "Conecta los nodos correctamente"
else:
    style_name = style_list[selected_index]
    with doc.LockDocument():
        with db.TransactionManager.StartTransaction() as tr:
            for styleId in civDoc.Styles.AlignmentStyles:
                style = tr.GetObject(styleId, OpenMode.ForRead)
                if style.Name == style_name:
                    target_style_id = styleId
                    break

            if target_style_id is None:
                OUT = "Estilo no encontrado: " + style_name
            else:
                bt = tr.GetObject(db.BlockTableId, OpenMode.ForRead)
                btr = tr.GetObject(bt[BlockTableRecord.ModelSpace], OpenMode.ForRead)

                for objId in btr:
                    obj = tr.GetObject(objId, OpenMode.ForRead)
                    if isinstance(obj, Alignment):
                        obj.UpgradeOpen()
                        obj.StyleId = target_style_id
                        results.append(obj.Name)

                tr.Commit()
                OUT = results
# ----------------------------------------
watch = Watch(python_script_2)
te_muestra_el_estilo_para = Watch(python_script)  # "te muestra el estilo para elegirlo con precision"
