# Dynamo graph RENUMERACION DE LAYOUTS.dyn (Dynamo 4.0.2.3852)

prefix = StringInput("")
startNumber = IntegerSlider(75, range=1..100 step 1)
padding = IntegerSlider(2, range=0..100 step 1)
python_script = Python(IN[0]=prefix, IN[1]=startNumber, IN[2]=padding)  # PythonNet3
# ---------- python_script.python (40 lines) ----------
import clr
clr.AddReference('AcMgd')
clr.AddReference('AcDbMgd')
from Autodesk.AutoCAD.ApplicationServices import Application
from Autodesk.AutoCAD.DatabaseServices import *
from Autodesk.AutoCAD.Runtime import *
import re
doc = Application.DocumentManager.MdiActiveDocument
db = doc.Database
prefix = IN[0] if IN[0] is not None else None
start_number = int(IN[1]) if IN[1] is not None else 1
padding = int(IN[2]) if IN[2] else 2
clean_pattern = re.compile(r'^\s*(?:[A-Za-z]{0,3}-)?\d+\s*[-_]\s*', re.IGNORECASE)
renamed = []
with doc.LockDocument():
    with db.TransactionManager.StartTransaction() as tr:
        layout_dict = tr.GetObject(db.LayoutDictionaryId, OpenMode.ForRead)
        layouts_in_order = []
        for entry in layout_dict:
            lid = entry.Value
            lyt = tr.GetObject(lid, OpenMode.ForRead)
            name = lyt.LayoutName
            if name.lower() != "model":
                layouts_in_order.append((lyt.TabOrder, name, lid))
        layouts_in_order.sort(key=lambda x: x[0])
        layout_names = [n for _, n, _ in layouts_in_order]
        for idx, original in enumerate(layout_names):
            new_number = start_number + idx
            if prefix:
                new_name = "{0}-{1:0{2}d}".format(prefix, new_number, padding)
            elif prefix == "":
                new_name = "{1:0{2}d}".format(prefix, new_number, padding)
            else:
                new_name = "{0:0{1}d}".format(new_number, padding)
            block_id = layout_dict.GetAt(original)
            lyt = tr.GetObject(block_id, OpenMode.ForWrite)
            lyt.LayoutName = new_name
            renamed.append("'{0}' -> '{1}'".format(original, new_name))
        tr.Commit()
OUT = renamed
# ----------------------------------------
watch = Watch(python_script)
